# Grasshopper definition Walker_Gaussian.gh (Grasshopper 0.9.76)
# plug-ins: Python Interpreter

number_slider = Slider(1334, range=0..10000)
number_slider_2 = Slider(0, range=0..100)
number_slider_3 = Slider(76952, range=0..100000)
number_slider_4 = Slider(22, range=0..100)
pt = Point(<point referenced from the Rhino model>)
number_slider_5 = Slider(2000, range=0..10000)  # disabled
number_slider_6 = Slider(76952, range=0..100000)  # disabled
gaussian_ptcloud = PythonScript(
    seed=number_slider_3,
    PointNum=Slider(932, range=0..1000),
    CenterPoint=pt,
    sdX=number_slider_4,
    sdY=number_slider_4,
    sdZ=number_slider_4)  # -> out, a; inputs PointNum: Int32, CenterPoint: Point3d
# ---------- gaussian_ptcloud: Python ----------
import rhinoscriptsyntax as rs
import random as r

r.seed(seed)
if seed == None : seed = 0 
if sdX == None: sdX = 20
if sdY == None: sdY = 20
if sdZ == None: sdZ = 20
if CenterPoint == None : CenterPoint = [0,0,0]
if PointNum == None : PointNum = 50

list = [] 

for c in range(PointNum):
    x = r.gauss(CenterPoint[0],sdX)
    y = r.gauss(CenterPoint[1],sdY)
    z = r.gauss(CenterPoint[2],sdZ)
    
    point = rs.AddPoint(x,y,z)
    
    list.append(point)
    
a = list
# ---------- end gaussian_ptcloud ----------
python = PythonScript(count=number_slider, seed=Slider(58683, range=0..100000), mean=number_slider_2, sd=Slider(25, range=0..100))  # -> out, a; inputs count: Int32
# ---------- python: Python ----------
import rhinoscriptsyntax as rs
import random as r

r.seed(seed)

list = [] 

for c in range(count):
    rand = r.gauss(mean,sd)
    list.append(rand)
    
a = list
# ---------- end python ----------
python_2 = PythonScript(count=number_slider, seed=Slider(35606, range=0..100000), mean=number_slider_2, sd=Slider(45, range=0..100))  # -> out, a; inputs count: Int32; same code as python
python_3 = PythonScript(count=number_slider, seed=number_slider_3, mean=number_slider_2, sd=Slider(25, range=0..100))  # -> out, a; inputs count: Int32; same code as python
python_4 = PythonScript(time=number_slider_5, seed=number_slider_6)  # -> out, a; inputs time: Int32; disabled
# ---------- python_4: Python ----------
import rhinoscriptsyntax as rs
import random as r

r.seed(seed)

class Walker:
    def __init__(self):
        self.x = 0
        self.y = 0
        self.z = 0
        
    def point(self):
        shape = rs.AddPoint(self.x,self.y,self.z)
        return shape
        
    def step(self):
        
        stepX = r.uniform(-1,1)
        stepY = r.uniform(-1,1)
        stepZ = r.uniform(-1,1)
        
        self.x += stepX
        self.y += stepY
        self.z += stepZ

            
            
w = Walker()

pList = []

for t in range(time):
    w.step()
    pList.append(w.point())

a = pList
print pList
# ---------- end python_4 ----------
pt_2 = Point(gaussian_ptcloud.a)
pt_3 = ConstructPoint(XCoordinate=python_3.a, YCoordinate=python_2.a, ZCoordinate=python.a)
